# Grasshopper definition semanticGeometry.gh (Grasshopper 1.0.7)
# Copyright: Coprat
# plug-ins: Human

number_slider = Slider(3, range=0..10)
mesh_sphere = MeshSphere(Base=PlaneXY(0, 0, 0), Radius=10, UCount=number_slider, VCount=number_slider)
deconstruct_mesh = DeconstructMesh(Mesh=mesh_sphere)  # -> Vertices, Faces, Colours, Normals
construct_mesh = ConstructMesh(Vertices=deconstruct_mesh.Vertices, Faces=graft(deconstruct_mesh.Faces))  # -> flatten(Mesh)

# ---- group: colours
list_length = ListLength(List=construct_mesh)
random = Random(Range="0 To 255", Number=expr("x*3", list_length), Seed=2)
integer = Integer(random)
partition_list = PartitionList(List=integer, Size=3)
list_item = ListItem(List=partition_list, Index=0, Wrap=True)  # -> Item, Item1, Item2
colour_rgb = ColourRGB(Alpha=255, Red=list_item.Item, Green=list_item.Item1, Blue=list_item.Item2)  # -> flatten(Colour)

# ---- group: areas
area = Area(Geometry=construct_mesh)  # -> Area, Centroid
expression = Expression(a=area.Area, Expression="Round(a,2)")

# ---- group: prices
panel = Panel("100")
multiplication = Multiplication(A=panel, B=area.Area)
expression_2 = Expression(a=multiplication, Expression="Round(a,2)")

# ---- group: keys
panel_2 = Panel("""colourKey
areaKey
priceKey""")
longest_list = LongestList(ListListA=graft(panel_2), ListListB=construct_mesh, PaddingMode=2)  # -> ListListA, ListListB

# ----
entwine = Entwine(Branch00=colour_rgb, Branch01=expression, Branch02=expression_2, FlattenInputs=True)
create_modify_layers = CreateModifyLayers(LayerName="bakedObj", DeleteLayer=False, enableFullPath=False)  # -> LayerNames, LayerFullPath
flip_matrix = FlipMatrix(Data=entwine)
flip_matrix_2 = FlipMatrix(Data=longest_list.ListListA)
createattributes = CreateAttributes(
    LayerName=create_modify_layers.LayerFullPath,
    UserDataKeys=flip_matrix_2,
    UserDataValues=flip_matrix,
    enableFullPath=False)  # -> flatten(ObjectAttributes)
bake = BooleanToggle(True)
bake_geometry = BakeGeometry(Bake=bake, Geometry=construct_mesh, Attributes=createattributes, DeleteOldBakes=False, PreserveTrees=False)
dynamic_geometry_pipeline = DynamicGeometryPipeline(
    LayerFilter="bakedObj",
    TypeFilter="Mesh",
    NameFilter="*",
    GroupByLayer=False,
    GroupByType=False,
    IncludeHidden=True,
    IncludeLocked=True,
    enableFullPath=False,
    listenToAttributes=True)
object_attributes = ObjectAttributes(ObjectOrAttributes=dynamic_geometry_pipeline)  # -> Name, LayerName, LayerFullPath, Color, MaterialName, LinetypeName, GroupIndices, PlotWeight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
move = Move(Geometry=dynamic_geometry_pipeline, Motion=Vector(25, 0, 0))  # -> Geometry, Transform

# ---- group: read attributes
member_index = MemberIndex(Set=object_attributes.UserDataKeys, Member="areaKey")  # -> Index, Count
member_index_2 = MemberIndex(Set=object_attributes.UserDataKeys, Member="priceKey")  # -> Index, Count
member_index_3 = MemberIndex(Set=object_attributes.UserDataKeys, Member="colourKey")  # -> Index, Count
face_normals = FaceNormals(Mesh=move.Geometry)  # -> flatten(Centers), Normals
list_item_2 = ListItem(List=object_attributes.UserDataValues, Index=member_index_3.Index, Wrap=True)  # -> flatten(Item)
list_item_3 = ListItem(List=object_attributes.UserDataValues, Index=member_index.Index, Wrap=True)  # -> flatten(Item)
list_item_4 = ListItem(List=object_attributes.UserDataValues, Index=member_index_2.Index, Wrap=True)  # -> flatten(Item)
panel_3 = Panel("""Area: {0}
Price: {1}""")
format = Format(Format=panel_3, Culture=127, Data0=list_item_3, Data1=list_item_4)

# ----
text_tag = TextTag(Location=face_normals.Centers, Text=format, Colour=RGB(0, 0, 0))
custom_preview = CustomPreview(Geometry=move.Geometry, Material=list_item_2)
